# Grasshopper definition GH to SVG beta_Co-de-iT_0.9.0076.gh (Grasshopper 0.9.76)
# Copyright: Co-de-iT

# © Co-de-iT 2013-2017 _ Creative Commons Attribution-NonCommercial-ShareAlike3.0 UnportedLicense.
# GH to SVG
# GH definition to draw your graphics directly from grasshopper
# 
# Instructions: check the link https://github.com/Co-de-iT/GH2SVG
# 
# (c) Co-de-iT 2013-2017 - visit www.co-de-it.com for more GH code - UPDATED FOR Grasshopper 0.9.0076
panel = Panel("")  # disabled

# ---- group: DATA
panel_2 = Panel("""#nextHUMAN
#nextFOOD
#nextLOVE
#nextMATERIAL
#nextINTERFACES
#nextFASHION
#nextEDU
#nextHEALTH""")
panel_3 = Panel("""22
7
13
17
8
14
29
35""")
stack = StackData(Data=graft(panel_2), Stack=graft(panel_3))

# ----
lng = ListLength(List=stack)
ma = MassAddition(Input=flatten(lng))  # -> Result, PartialResults
lng_2 = ListLength(List=flatten(stack))
range = Range(Domain=Domain(0, 1), Steps=lng_2)
ins = InsertItems(List=ma.PartialResults, Item="0", Indices="0", Wrap=True)
cir = Circle(Plane="350,350,0", Radius=Slider(250, range=0..400))
cir_2 = Circle(Plane="350,350,0", Radius=Slider(20, range=0..100))
lng_3 = ListLength(List=ins)
eval = EvaluateCurve(Curve=reparameterize(cir), Parameter=range)  # -> Point, Tangent, Angle
cull_i = CullIndex(List=ins, Indices=expr("x-1", lng_3), Wrap=True)
series = Series(Start=graft(cull_i), Step=1, Count=lng)
Z = UnitZ(Factor=1)
rad = Radians(Degrees="90")
item = ListItem(List=range, Index=series, Wrap=True)
vrot = Rotate(Vector=eval.Tangent, Axis=Z, Angle=rad)
avr = Average(Input=item)
vdis = VectorDisplay(Anchor=eval.Point, Vector=vrot)
flatten = FlattenTree(Tree=avr, Path="{0}")
eval_2 = EvaluateCurve(Curve=reparameterize(cir_2), Parameter=flatten)  # -> Point, Tangent, Angle

# ---- group: Colors
lng_4 = ListLength(List=panel_2)
range_2 = Range(Domain=Domain(0, 1), Steps=expr("x-1", lng_4))
gradient = Gradient(LowerLimit=0, UpperLimit=1, Parameter=range_2, stops=[0: RGB(0, 160, 0), 0.5: RGB(0, 137, 255), 1: RGB(175, 0, 108)])
stack_2 = StackData(Data=graft(gradient), Stack=graft(panel_3))

# ----
ln = Line(StartPoint="350,350,0", EndPoint=eval_2.Point)
Z_2 = UnitZ(Factor=1)
rad_2 = Radians(Degrees="270")
vrot_2 = Rotate(Vector=eval_2.Tangent, Axis=Z_2, Angle=rad_2)
amp = Amplitude(Vector=vrot, Amplitude=Slider(104.56, range=0..200))
amp_2 = Amplitude(Vector=vrot_2, Amplitude=Slider(57, range=0..200))
graft = GraftTree(Tree=eval_2.Point, IncludeEmptyLists=True, IncludeNullItems=True)
item_2 = ListItem(List=eval.Point, Index=series, Wrap=True)
graft_2 = GraftTree(Tree=amp_2, IncludeEmptyLists=True, IncludeNullItems=True)
item_3 = ListItem(List=amp, Index=series, Wrap=True)
rev = Reverse(Vector=item_3)
pline = PolyLine(Vertices=eval_2.Point, Closed=Toggle(True))
pline_2 = PolyLine(Vertices=item_2, Closed=False)
bzspan = BezierSpan(StartPoint=graft, StartTangent=graft_2, EndPoint=item_2, EndTangent=item_3)  # -> Curve, Length, Domain
rev_2 = Reverse(Vector=graft(item_3))
X = UnitX(Factor=1)
xy = XYPlane(Origin=Point(0, 0, 0))
angle = Angle(VectorA=X, VectorB=simplify(rev_2), Plane=xy)  # -> Angle, Reflex
deg = Degrees(Radians=angle.Angle)

graft_3 = GraftTree(Tree=simplify(ln), IncludeEmptyLists=True, IncludeNullItems=True)

# ---- group: POLYGON
list = ValueList({"No Fill": 0, "Fill": 1}, selected="No Fill")
crv = Curve(pline)

# ---- group: CURVES
simplify = SimplifyTree(Tree=stack_2, Front=False)
# GH to SVG - components & composer
simplify_2 = SimplifyTree(Tree=bzspan.Curve, Front=False)

# ---- group: LINE
panel_4 = Panel("10,5")

# ---- group: CIRCLE
simplify_3 = SimplifyTree(Tree=item_2, Front=False)
swatch = ColourSwatch(SwatchColor=RGB(170, 234, 255))
col = Colour(simplify(stack_2))
list_2 = ValueList({"No Fill": 0, "Fill": 1}, selected="No Fill")

# ---- group: POLYLINE
simplify_4 = SimplifyTree(Tree=stack_2, Front=False)
panel_5 = Panel("12,4")
crv_2 = Curve(pline_2)

# ---- group: TEXT
list_3 = ValueList({"Arial": "arial", "Verdana": "verdana", "Tahoma": "tahoma", "Data Control": "data control", "Birdman": "birdman"}, selected="Verdana")
graft_4 = GraftTree(Tree=simplify(item_2), IncludeEmptyLists=True, IncludeNullItems=True)
graft_5 = GraftTree(Tree=simplify(stack), IncludeEmptyLists=True, IncludeNullItems=True)
graft_6 = GraftTree(Tree=simplify(deg), IncludeEmptyLists=True, IncludeNullItems=True)
list_4 = ValueList({"Normal": "normal", "Bold": "bold"}, selected="Normal")
list_5 = ValueList({"Normal": "normal", "Italic": "italic"}, selected="Normal")
list_6 = ValueList({"start", "middle", "end"}, selected="start")

# ---- group: COMPOSER
panel_6 = Panel("700")

# ---- group: TEXT (continued)
int = Integer(panel_6)
cluster = Cluster(
    background_height=int,
    text_position=graft_4,
    text_shift_x=Slider(5, range=-50..50),
    text_shift_y=Slider(0, range=-50..50),
    B=graft_6,
    font_name=list_3,
    font_size=Slider(8, range=0..100),
    font_weight=list_4,
    font_style=list_5,
    font_justification=list_6,
    text_color=ColourSwatch(SwatchColor=RGB(161, 161, 161)),
    text_string_2=graft_5)
flatten_2 = FlattenTree(Tree=cluster, Path="{0}")

# ---- group: LINE (continued)
int_2 = Integer(panel_6)
cluster_2 = Cluster_3(background_height=int_2, C=graft_3, R=ColourSwatch(SwatchColor=RGB(69, 108, 215)), R_2=Slider(1.5, range=0..5))
flatten_3 = FlattenTree(Tree=cluster_2, Path="{0}")

# ---- group: POLYGON (continued)
int_3 = Integer(panel_6)
cluster_3 = Cluster_6(
    background_height=int_3,
    polygon=crv,
    stroke_color=ColourSwatch(SwatchColor=RGB(0, 92, 125)),
    stroke_width=Slider(0.25, range=0..5),
    fill_options=list,
    fill_color=ColourSwatch(SwatchColor=RGB(184, 184, 184)))
flatten_4 = FlattenTree(Tree=cluster_3, Path="{0}")

# ---- group: POLYLINE (continued)
int_4 = Integer(panel_6)
cluster_4 = Cluster_5(background_height=int_4, polyline=crv_2, stroke_color=simplify_4, stroke_width=Slider(0.8, range=0..5))
flatten_5 = FlattenTree(Tree=cluster_4, Path="{0}")

# ---- group: CIRCLE (continued)
int_5 = Integer(panel_6)
cluster_5 = Cluster_4(
    background_height=int_5,
    position=simplify_3,
    radius=Slider(2, range=0..5),
    stroke_color=col,
    stroke_width=Slider(2, range=0..5),
    fill_options=list_2)
flatten_6 = FlattenTree(Tree=cluster_5, Path="{0}")

# ---- group: CURVES (continued)
cluster_6 = Cluster_7(
    curves=simplify_2,
    background_height=panel_6,
    stroke_color=simplify,
    stroke_width=Slider(0.22, range=0..1),
    draw_points=Toggle(False))  # -> points_2, curve_svg_2
flatten_7 = FlattenTree(Tree=cluster_6.curve_svg_2, Path="{0}")
pt = Point(cluster_6.points_2)

# ---- group: COMPOSER (continued)
merge = Merge(Data1=flatten_4, Data2=flatten_2, Data3=flatten_3, Data4=flatten_6, Data5=flatten_7, Data6=flatten_5)
cluster_7 = Cluster_2(
    background_width="1000",
    background_height=panel_6,
    background_color=ColourSwatch(SwatchColor=RGB(255, 255, 255)),
    data=merge)

# ----
svg_code = Panel(cluster_7)

# ----
# Save SVG file
dir_type = ValueList({"desktop": 0, "documents": 1, "GH file path": 2, "C:": 3}, selected="GH file path")
pathg = PathGenerator(type=dir_type)  # -> dir; inputs type: Int32, subDir: String
# ---------- pathg: C# ----------
                       /*
    froGH - a sparse collection of (in)utilities for Grasshopper

    Path Generator
    code by Alessio Erioli - value list generation based on code by James Ramsden

    froGH by Co-de-iT is licensed under a Creative Commons Attribution 4.0 International License.
    http://creativecommons.org/licenses/by/4.0/

    */
    initComp();


    String S = "";
    String root = "";
    String end = "\\";
    String eol = Environment.NewLine;

    // __________________ autoList part __________________

    // variable for the list
    Grasshopper.Kernel.Special.GH_ValueList vList;
    // tries to cast input as list
    try{

      // if the list is not the first parameter then change Input[0] to the corresponding value
      vList = (Grasshopper.Kernel.Special.GH_ValueList) Component.Params.Input[0].Sources[0];
      // Print("value list connected");
      // check if the list must be created
      //if (vList.NickName != "dir type"){
      if (!vList.NickName.Equals("dir type")){
        vList.ClearData();
        vList.ListItems.Clear();
        vList.NickName = "dir type";
        var item1 = new Grasshopper.Kernel.Special.GH_ValueListItem("desktop", "0");
        var item2 = new Grasshopper.Kernel.Special.GH_ValueListItem("documents", "1");
        var item3 = new Grasshopper.Kernel.Special.GH_ValueListItem("GH file path", "2");
        var item4 = new Grasshopper.Kernel.Special.GH_ValueListItem("C:", "3");
        vList.ListItems.Add(item1);
        vList.ListItems.Add(item2);
        vList.ListItems.Add(item3);
        vList.ListItems.Add(item4);

        vList.ListItems[0].Value.CastTo(out type);
      }
    }
    catch{
      // handles anything that is not a value list
    }


    switch(type){
      case 0:
        root = Environment.GetFolderPath(Environment.SpecialFolder.Desktop)+ end;
        S = "Desktop";
        break;
      case 1:
        root = Environment.GetFolderPath(Environment.SpecialFolder.MyDocuments)+end;
        S = "Documents";
        break;
      case 2:
        GH_Document ghDoc = owner.OnPingDocument();

        if (ghDoc.IsFilePathDefined)
        {
          int nameLen = ghDoc.DisplayName.TrimEnd('*').Length + 3; // +3 accounts for the '.gh' extension
          int fileLen = ghDoc.FilePath.TrimEnd('*').Length;

          //F = ghDoc.DisplayName.TrimEnd('*');
          root = ghDoc.FilePath.Substring(0, fileLen - nameLen);
          //root = gh_d.FilePath;
          S = "GH File path";
        }
        else
        {
          Print("No path defined. Saving to Desktop until then");
          root = Environment.GetFolderPath(Environment.SpecialFolder.Desktop);
          S = "Desktop";
        }
        break;
      case 3:
        root = "C:"+end;
        S = root + end;
        break;
    }
    dir = root + (subDir != null ? (subDir + end) : "");
    Component.Message = S;
# ---------- pathg: C# additional code ----------
  void initComp(){
    Component.Name = "Path Generator";
    Component.NickName = "PathG";
    Component.Description = "generates a path based on local direcories such as Desktop, Documents, GH file path";
    Component.Params.Input[0].Name = "dir type";
    Component.Params.Input[0].Description = "directory type: 0 desktop, 1 documents, 2 GH file path, 3 C:\nconnect a value list for automatic list generation";
    Component.Params.Input[1].Name = "custom subdir";
    Component.Params.Input[1].Description = "(optional) custom subdirectory";
  }
# ---------- end pathg ----------
save = Button()
savetofile = SaveToFile(S=cluster_7, dir=pathg, file="datagraph.svg", save=save)  # -> info; inputs S: list of String, dir: String, file: String, save: Boolean
# ---------- savetofile: C# ----------
                   /*
    froGH - a sparse collection of (in)utilities for Grasshopper

    Save string to file
    
    code by Alessio Erioli

    froGH by Co-de-iT is licensed under a Creative Commons Attribution 4.0 International License.
    http://creativecommons.org/licenses/by/4.0/

    */

    initComp();



    if (save){
      if (!Directory.Exists(dir)) Directory.CreateDirectory(dir);

      String target = dir + file;

      System.IO.File.WriteAllLines(target, S.ToArray());
      info = "file saved as: " + target;
    } else {
      info = "press save button to save file";
    }
# ---------- savetofile: C# additional code ----------
  void initComp(){
    Component.Name = "Save to File";
    Component.NickName = "SaveToFile";
    Component.Description = "Saves a text sequence to a file";

    Component.Params.Input[0].Name = "String";
    Component.Params.Input[0].Description = "string to save (as List)";
    Component.Params.Input[1].Name = "directory";
    Component.Params.Input[1].Description = "directory where the string file is saved";
    Component.Params.Input[2].Name = "fileName";
    Component.Params.Input[2].Description = "file name and extension (ex: myText.txt)";
    Component.Params.Input[3].Name = "save";
    Component.Params.Input[3].Description = "activate saving - attach a button and click to save";
    Component.Params.Output[0].Name = "info";
    Component.Params.Output[0].Description = "information on the saving process";
  }
# ---------- end savetofile ----------
panel_7 = Panel(pathg)
panel_8 = Panel(savetofile)

# ==== cluster Cluster
text_string = Panel("  <text x=\"X\" y=\"Y\" dx=\"Z\" dy=\"U\" transform=\"rotate(A X,Y)\" font-family=\"F\" font-size=\"S\" font-weight=\"B\" font-style=\"L\" fill=\"rgb(C)\" text-anchor=\"J\">T</text>")
text_position = ClusterInput()
background_height = ClusterInput()
text_position_2 = Point(text_position)
pdecon = Deconstruct(Point=text_position_2)  # -> XComponent, YComponent, ZComponent
background_height_2 = Integer(background_height)
subtraction = Subtraction(A=background_height_2, B=pdecon.YComponent)
rep = ReplaceText(Text=text_string, Find="X", Replace=pdecon.XComponent, RecursiveReplace=False)
B = ClusterInput()
text_shift_x = ClusterInput()
rep_2 = ReplaceText(Text=rep, Find="Y", Replace=subtraction, RecursiveReplace=False)
pi = Pi(Factor="0.5")
rep_3 = ReplaceText(Text=rep_2, Find="Z", TextShiftX=text_shift_x, RecursiveReplace=False)
text_shift_y = ClusterInput()
subtraction_2 = Subtraction(A=pi, B=B)
rep_4 = ReplaceText(Text=rep_3, Find="U", TextShiftY=text_shift_y, RecursiveReplace=False)
font_name = ClusterInput()
rep_5 = ReplaceText(Text=rep_4, Find="A", TextRotation=subtraction_2, RecursiveReplace=False)
rep_6 = ReplaceText(Text=rep_5, Find="F", FontName=font_name, RecursiveReplace=False)
font_size = ClusterInput()
font_weight = ClusterInput()
rep_7 = ReplaceText(Text=rep_6, Find="S", FontSize=font_size, RecursiveReplace=False)
rep_8 = ReplaceText(Text=rep_7, Find="B", FontWeight=font_weight, RecursiveReplace=False)
font_style = ClusterInput()
font_justification = ClusterInput()
rep_9 = ReplaceText(Text=rep_8, Find="L", FontStyle=font_style, RecursiveReplace=False)
rep_10 = ReplaceText(Text=rep_9, Find="J", FontJustification=font_justification, RecursiveReplace=False)
text_color = ClusterInput()
text_string_2 = ClusterInput()
rep_11 = ReplaceText(Text=rep_10, Find="C", TextColor=text_color, RecursiveReplace=False)
rep_12 = ReplaceText(Text=rep_11, Find="T", TextString=text_string_2, RecursiveReplace=False)
text_svg = ClusterOutput(rep_12)

# ==== cluster Cluster_2
background_details = Panel("<svg xmlns=\"http://www.w3.org/2000/svg\" version=\"1.1\" width=\"W\" height=\"H\" style=\"background-color:rgb(C)\">")
background_width = ClusterInput()
rep = ReplaceText(Text=background_details, Find="W", BackgroundWidth=background_width, RecursiveReplace=False)
background_height = ClusterInput()
rep_2 = ReplaceText(Text=rep, Find="H", BackgroundHeight=background_height, RecursiveReplace=False)
background_color = ClusterInput()
rep_3 = ReplaceText(Text=rep_2, Find="C", BackgroundColor=background_color, RecursiveReplace=False)
data = ClusterInput()
data_2 = Data(data)
merge = Merge(Data1=rep_3, Data2=data_2, Data3="</svg>")
svg_composer = ClusterOutput(merge)

# ==== cluster Cluster_3
background_height = ClusterInput()
C = ClusterInput()
line_string = Panel("<line x1=\"X\" y1=\"Y\" x2=\"W\" y2=\"V\" style=\"stroke:rgb(C);stroke-width:S;stroke-dasharray:A;\" />")
end = EndPoints(Curve=C)  # -> Start, End
pdecon = Deconstruct(Point=end.Start)  # -> XComponent, YComponent, ZComponent
pdecon_2 = Deconstruct(Point=end.End)  # -> XComponent, YComponent, ZComponent
subtraction = Subtraction(BackgroundHeight=background_height, B=pdecon.YComponent)
subtraction_2 = Subtraction(BackgroundHeight=background_height, B=pdecon_2.YComponent)
rep = ReplaceText(Text=line_string, Find="X", Replace=pdecon.XComponent, RecursiveReplace=False)
rep_2 = ReplaceText(Text=rep, Find="Y", Replace=subtraction, RecursiveReplace=False)
rep_3 = ReplaceText(Text=rep_2, Find="W", Replace=pdecon_2.XComponent, RecursiveReplace=False)
rep_4 = ReplaceText(Text=rep_3, Find="V", Replace=subtraction_2, RecursiveReplace=False)
R = ClusterInput()
rep_5 = ReplaceText(Text=rep_4, Find="C", Replace=R, RecursiveReplace=False)
R_2 = ClusterInput()
R_3 = ClusterInput()
rep_6 = ReplaceText(Text=rep_5, Find="S", Replace=R_2, RecursiveReplace=False)
rep_7 = ReplaceText(Text=rep_6, Find="A", Replace=R_3, RecursiveReplace=False)
R_4 = ClusterOutput(rep_7)

# ==== cluster Cluster_4
position = ClusterInput()
circle_string = Panel("  <circle cx=\"X\" cy=\"Y\" r=\"R\" stroke=\"rgb(S)\" stroke-width=\"W\"  fill=\"F\" />")
pdecon = Deconstruct(Position=position)  # -> XComponent, YComponent, ZComponent
background_height = ClusterInput()
subtraction = Subtraction(BackgroundHeight=background_height, B=pdecon.YComponent)
fill_options = ClusterInput()
rep = ReplaceText(Text=circle_string, Find="X", Replace=pdecon.XComponent, RecursiveReplace=False)
B = ClusterInput()
radius = ClusterInput()
rep_2 = ReplaceText(Text=rep, Find="Y", Replace=subtraction, RecursiveReplace=False)
stroke_color = ClusterInput()
rep_3 = ReplaceText(Text=rep_2, Find="R", Replace=radius, RecursiveReplace=False)
stroke_width = ClusterInput()
concat = Concatenate(FragmentA="rgb(", FragmentB=B, FragmentC=")")
filter = StreamFilter(FillOptions=fill_options, Stream0="none", Stream1=concat)
rep_4 = ReplaceText(Text=rep_3, Find="S", StrokeColor=stroke_color, RecursiveReplace=False)
rep_5 = ReplaceText(Text=rep_4, Find="W", StrokeWidth=stroke_width, RecursiveReplace=False)
rep_6 = ReplaceText(Text=rep_5, Find="F", FillColor=filter, RecursiveReplace=False)
circle_svg = ClusterOutput(rep_6)

# ==== cluster Cluster_5
polyline = ClusterInput()
disc = Discontinuity(Polyline=polyline, Level=1)  # -> Points, Parameters
pdecon = Deconstruct(Point=disc.Points)  # -> XComponent, YComponent, ZComponent
background_height = ClusterInput()
polyline_string = Panel("<polyline points=\"C\" stroke=\"rgb(S)\" stroke-width=\"W\" stroke-dasharray=\"A\" fill=\"none\" />")
subtraction = Subtraction(BackgroundHeight=background_height, B=pdecon.YComponent)
concat = Concatenate(FragmentA=pdecon.XComponent, FragmentB=",", FragmentC=subtraction, FragmentD=" ")
join = TextJoin(Text=concat)
stroke_color = ClusterInput()
rep = ReplaceText(Text=polyline_string, Find="C", Replace=join, RecursiveReplace=False)
stroke_width = ClusterInput()
rep_2 = ReplaceText(Text=rep, Find="S", StrokeColor=stroke_color, RecursiveReplace=False)
rep_3 = ReplaceText(Text=rep_2, Find="W", StrokeWidth=stroke_width, RecursiveReplace=False)
stroke_dasharray = ClusterInput()
rep_4 = ReplaceText(Text=rep_3, Find="A", StrokeDasharray=stroke_dasharray, RecursiveReplace=False)
polyline_svg = ClusterOutput(rep_4)

# ==== cluster Cluster_6
polygon = ClusterInput()
disc = Discontinuity(Polygon=polygon, Level=1)  # -> Points, Parameters
polygon_string = Panel("<polygon points=\"C\" stroke=\"rgb(S)\" stroke-width=\"W\" fill=\"F\" />")
fill_color = ClusterInput()
pdecon = Deconstruct(Point=disc.Points)  # -> XComponent, YComponent, ZComponent
background_height = ClusterInput()
concat = Concatenate(FragmentA="rgb(", FragmentB=fill_color, FragmentC=")")
fill_options = ClusterInput()
subtraction = Subtraction(BackgroundHeight=background_height, B=pdecon.YComponent)
filter = StreamFilter(FillOptions=fill_options, Stream0="none", Stream1=concat)
concat_2 = Concatenate(FragmentA=pdecon.XComponent, FragmentB=",", FragmentC=subtraction, FragmentD=" ")
join = TextJoin(Text=concat_2)
stroke_color = ClusterInput()
rep = ReplaceText(Text=polygon_string, Find="C", Replace=join, RecursiveReplace=False)
rep_2 = ReplaceText(Text=rep, Find="S", StrokeColor=stroke_color, RecursiveReplace=False)
stroke_width = ClusterInput()
rep_3 = ReplaceText(Text=rep_2, Find="W", StrokeWidth=stroke_width, RecursiveReplace=False)
rep_4 = ReplaceText(Text=rep_3, Find="F", Replace=filter, RecursiveReplace=False)
polygon_svg = ClusterOutput(rep_4)

# ==== cluster Cluster_7
draw_points = ClusterInput()
curves = ClusterInput()
background_height = ClusterInput()
stroke_color = ClusterInput()
stroke_width = ClusterInput()
draw_points_2 = Boolean(draw_points)
curves_2 = Curve(curves)
background_height_2 = Integer(background_height)
stroke_color_2 = Colour(stroke_color)
stroke_width_2 = Number(stroke_width)
svgnurbs = NURBSCurvesToSVG(C=curves_2, height=background_height_2, col=stroke_color_2, width=stroke_width_2, drawPts=draw_points_2)  # -> Pts, SVG; inputs C: Curve, height: Double, col: Color, width: Double, drawPts: Boolean
# ---------- svgnurbs: C# ----------
                         /*

    insight from here: http://www.grasshopper3d.com/forum/topics/beziers-vs-nurbs-world-space-and-screen-space
    BIG thanks to Steve Baer for pointing to the BezierCurve class!!!

    */

    initComp();

    // initialize strings for SVG output
    string sep = Environment.NewLine;
    //string head = "<svg xmlns = \"http://www.w3.org/2000/svg\" version = \"1.1\">" + sep;
    //string end = "</svg>";
    string curv = "";
    string pts = "";

    //Print(col.ToString());
    //Print(col.GetHashCode().ToString("X2"));
    string Hex = col.GetHashCode().ToString("X2");
    string HexCol = "#" + Hex.Substring(2, 6);

    // initialize curves
    NurbsCurve Cn = C.ToNurbsCurve();
    BezierCurve[] Bc = BezierCurve.CreateCubicBeziers(Cn, RhinoMath.SqrtEpsilon, 0.1);
    DataTree<Point3d> Ptree = new DataTree<Point3d>();
    DataTree<Point3d> PtreeOut = new DataTree<Point3d>();

    // create datatree with Cubic Béziers points
    for (int i = 0; i < Bc.Count(); i++){
      GH_Path path = new GH_Path();
      path.FromString("0,0," + i);
      List <Point3d> Pt = new List<Point3d>();
      for(int j = 0; j < Bc[i].ControlVertexCount; j++){
        Point3d p = Bc[i].GetControlVertex3d(j);
        PtreeOut.Add(p, path);
        p.Y = height - p.Y;
        Ptree.Add(p, path);
      }
    }

    // start curv to path parsing

    for (int i = 0; i < Ptree.BranchCount; i++){
      Point3d p0 = Ptree.Branch(i)[0];
      curv += "<path fill=\"none\" stroke=\"" + HexCol + "\" stroke-linecap=\"round\" stroke-linejoin=\"round\" stroke-width=\"" + width + "\" d=\"M" + Math.Round(p0.X) + "," + Math.Round(p0.Y) + sep;
      curv += "C";
      for (int j = 1; j < Ptree.Branch(i).Count; j++){
        Point3d p = Ptree.Branch(i)[j];
        curv += Math.Round(p.X) + "," + Math.Round(p.Y) + " ";
        //if(i < Ptree.BranchCount - 1 && j < Ptree.Branch(i).Count - 1) curv += " ";
      }
      curv += "\"/>" + sep;
    }

    // point drawing controlled by a toggle
    if (drawPts){
      for (int i = 0; i < Ptree.BranchCount; i++){
        for (int j = 0; j < Ptree.Branch(i).Count; j++){
          Point3d p = Ptree.Branch(i)[j];
          pts += "<circle cx = \"" + Math.Round(p.X) + "\" cy =\"" + Math.Round(p.Y) + "\" r = \"2\" fill = \"red\"/>" + sep;
        }
      }

    }

    Pts = PtreeOut;

    //SVG = head + curv + pts + end;
    SVG = curv + pts;
# ---------- svgnurbs: C# additional code ----------
  void initComp(){
    Component.Name = "NURBS Curves to SVG";
    Component.NickName = "SVGNURBS";
    Component.Description = "Converts NURBS curves to SVG";
  }
# ---------- end svgnurbs ----------
points = Point(svgnurbs.Pts)
curve_svg = Data(svgnurbs.SVG)
points_2 = ClusterOutput(points)
curve_svg_2 = ClusterOutput(curve_svg)
